# Dynamo graph Sample.dyn (Dynamo 2.1.0.7500)

# group: Zero Touch Gen Image
file_path = Filename("..\image\QImage.About.Information.Author.Large.png")  # graph input
fromPath = FileObject(path=file_path)  # "File.FromPath"
readFromFile = Image.ReadFromFile(file=fromPath)
watch_image = WatchImageCore(image=readFromFile)
code_block = CodeBlock { 150; }
resizeImage = QRImage.Image.Image.ResizeImage(image=watch_image, width=code_block, height=code_block)
dimensions = Image.Dimensions(image=resizeImage)
watch_image_2 = WatchImageCore(image=resizeImage)
string = StringInput("C:\Users\HO VAN CHUONG\Downloads\image\")  # graph input
file_path_2 = Filename("H:\revit\Dynamo\API\ZeroTouchNodeTemplate\bin\Debug\QImage.dll")  # graph input
exportmethod = QRImage.Image.Image.Exportmethod(dll=file_path_2)
code_block_2 = CodeBlock { ".Large"; }
code_block_3 = CodeBlock { ".png"; }
code_block_4 = CodeBlock(a=string, b=exportmethod, c=code_block_2, d=code_block_3) { a+b+c+d; }
saveAsImage = QRImage.Image.Image.SaveAsImage(path=code_block_4, image=resizeImage)

# group: GetFile
directory_path = Directory("C:\Users\Public\OneDrive - IZI Cloud\Ảnh\PythonAPI")  # graph input; frozen
getImagesPath = QRImage.Image.Image.GetImagesPath(folderName=directory_path)
getFileFolder = QRImage.Image.Image.GetFileFolder(folderName=directory_path)
code_block_5 = CodeBlock { "zip"; }
boolean = BoolSelector(true)  # graph input
getFilesFrom = QRImage.Image.Image.GetFilesFrom(filters=code_block_5, isRecursive=boolean)  # unwired: searchFolder

# group: Create QRCode
code_block_6 = CodeBlock { "XX"; }
code_block_7 = CodeBlock { 20; }
createQRCodeString = QRImage.QrCode.QrCode.CreateQRCodeString(str=code_block_6, Pixel=code_block_7)
watch_image_3 = WatchImageCore(image=createQRCodeString)
code_block_8 = CodeBlock { "Blue"; "White"; }
selectColorByName = QRImage.Color.Colors.SelectColorByName(NameColor=code_block_8.out0)
selectColorByName_2 = QRImage.Color.Colors.SelectColorByName(NameColor=code_block_8.out1)
createQRCodeColor = QRImage.QrCode.QrCode.CreateQRCodeColor(str=code_block_6, Pixel=code_block_7, ColorQR=selectColorByName, ColorBG=selectColorByName_2)
watch_image_4 = WatchImageCore(image=createQRCodeColor)
